vi "Function.gvi"   [LabVIEW NXG 3.1.0]
panel controls:
  "stop_2": bool
  "order": i32 = 2
  "low cutoff frequency": f64 = 0.125
  "high cutoff frequency": f64 = 0.45
  "fine tune low pass": f64
panel indicators:
  "filtered signal": waveform<f64>
  "acquired signal": waveform<f64>
  "original mag": T1
  "original phase": cluster{"f0": f64, "df": f64, "phase": f64[]}
  "filtered mag": T1
  "filtered phase": cluster{"f0": f64, "df": f64, "phase": f64[]}
types:
  T1 = cluster{"f0": f64, "df": f64, "magnitude": f64[]}
uses:
  NI::G Core::File IO (General)::Get System Directory.gvi
  NI::G Core::File IO (General)::Read Delimited Spreadsheet (DBL).gvi
  NI::Analysis::Filtering::Butterworth Bandpass Filter (Waveform).gvi
  NI::Analysis::Measurement::FFT Spectrum (Mag-Phase) (Single Shot) (Wfm DBL).gvi
diagram:
  call "Get System Directory.gvi"(type="User Desktop") -> (system directory=w1)
  Build Path(base path=w1, name or relative path="wow.csv") -> (appended path=w2)
  call "Read Delimited Spreadsheet (DBL).gvi"(file=w2) -> (all rows=w3)
  Array Index(array=w3) -> (out0[_, 0]=w4)
  Build Waveform Node(Y=w4, dt=0.001) -> (output waveform=w5)
  $"acquired signal" <- w5
  while {
    Add($"low cutoff frequency", $"fine tune low pass") -> w6
    Is Greater Than 0(x=w6) -> w7
    Is Greater(x=$"high cutoff frequency", y=w6) -> w8
    Logical And(w7, w8) -> w9
    case (w9) {
      frame False, Default { }
      frame True {
        call "Butterworth Bandpass Filter (Waveform).gvi"(signal=w5, low cutoff frequency=w6, high cutoff frequency=$"high cutoff frequency", order=$order) -> (filtered signal=w10)
        $"filtered signal" <- w10
        call "FFT Spectrum (Mag-Phase) (Single Shot) (Wfm DBL).gvi"(signal=w10) -> (magnitude=w11, phase=w12)
        $"filtered mag" <- w11
        $"filtered phase" <- w12
      }
    }
    stop if $stop_2
  }
  call "FFT Spectrum (Mag-Phase) (Single Shot) (Wfm DBL).gvi"(signal=w5) -> (magnitude=w13, phase=w14)
  $"original mag" <- w13
  $"original phase" <- w14
